# Grasshopper definition main.ghx (Grasshopper 1.0.7)

number_slider = Slider(10, range=0..10)
rectangle = Rectangle(Plane=PlaneXY(0, 0, 0), XSize=number_slider, YSize=number_slider, Radius=0)  # -> Rectangle, Length
rectangular_array = RectangularArray(Geometry=rectangle.Rectangle, Cell=rectangle.Rectangle, XCount=Slider(10, range=0..10), YCount=Slider(10, range=0..10))  # -> Geometry, Transform
random = Random(Range=Domain(0, 1), Number=Slider(10, range=0..10), Seed=2)
list_length = ListLength(List=rectangular_array.Geometry)  # -> expr("x-1", Length)
remap_numbers = RemapNumbers(Value=random, Source=Domain(0, 1), Target=list_length)  # -> Mapped, Clipped
integer = Integer(remap_numbers.Mapped)
list_item = ListItem(List=rectangular_array.Geometry, Index=integer, Wrap=False)
cull_index = CullIndex(List=rectangular_array.Geometry, Indices=integer, Wrap=True)
list_item_2 = ListItem(List=cull_index, Index=Slider(9, range=0..10), Wrap=True)
